% Simulink data dictionary ElectricMachine4.sldd

PlntEM4ExtSplySerRes = 0
PlntEM4RotInertia = 0.01
PlntEM4RotInitSpd = 0
PlntEM4TimeCnst = 0.02
PlntEM4EffPwrLossTempBpt = Simulink.Parameter([233.15 293.15 363.15])
PlntEM4TempPwrLoss = [233.15 293.15 363.15]
PlntEM4EffPwrLossSpdBpt = [0 81.8472 163.6944 245.5416 327.3889 409.2361 446.4203 491.0833 572.9305 654.7777 736.6249 818.4722 900.3194 982.1666]
PlntEM4EffPwrLossTrqBpt = [0 11.2 22.4 33.6 44.8 56 67.2 78.4 89.6 100.8 112]

PlntEM4MaxTqTbl = Simulink.Parameter([112 112 112 112 112
 112 112 112 112 112
 112 112 112 112 112
 112 112 112 112 112
 112 112 112 112 112
 94.02773 94.02773 94.02773 94.02773 94.02773
 75.22418 75.22418 75.22418 75.22418 75.22418
 62.68516 62.68516 62.68516 62.68516 62.68516
 53.73013 53.73013 53.73013 53.73013 53.73013
 47.01511 47.01511 47.01511 47.01511 47.01511
 41.79093 41.79093 41.79093 41.79093 41.79093
 37.61209 37.61209 37.61209 37.61209 37.61209
 34.19236 34.19236 34.19236 34.19236 34.19236
 31.34258 31.34258 31.34258 31.34258 31.34258])

PlntEM4MaxTqSpdBpt = Simulink.Parameter([0 81.8472 163.6944 245.5416 327.3889 409.2361 446.4203 491.0833 572.9305 654.7777 736.6249 818.4722 900.3194 982.1666])

PlntEM4MinTqTbl = Simulink.Parameter([-112 -112 -112 -112 -112
 -112 -112 -112 -112 -112
 -112 -112 -112 -112 -112
 -112 -112 -112 -112 -112
 -112 -112 -112 -112 -112
 -94.02773 -94.02773 -94.02773 -94.02773 -94.02773
 -75.22418 -75.22418 -75.22418 -75.22418 -75.22418
 -62.68516 -62.68516 -62.68516 -62.68516 -62.68516
 -53.73013 -53.73013 -53.73013 -53.73013 -53.73013
 -47.01511 -47.01511 -47.01511 -47.01511 -47.01511
 -41.79093 -41.79093 -41.79093 -41.79093 -41.79093
 -37.61209 -37.61209 -37.61209 -37.61209 -37.61209
 -34.19236 -34.19236 -34.19236 -34.19236 -34.19236
 -31.34258 -31.34258 -31.34258 -31.34258 -31.34258])

PlntEM4MinTqSpdBpt = Simulink.Parameter([0 81.8472 163.6944 245.5416 327.3889 409.2361 446.4203 491.0833 572.9305 654.7777 736.6249 818.4722 900.3194 982.1666])
PlntEM4SpdEff = [0 81.8472 163.6944 245.5416 327.3889 409.2361 446.4203 491.0833 572.9305 654.7777 736.6249 818.4722 900.3194 982.1666]
PlntEM4TrqEff = [0 11.2 22.4 33.6 44.8 56 67.2 78.4 89.6 100.8 112]
PlntEM4SpdLoss = [0 81.8472 163.6944 245.5416 327.3889 409.2361 446.4203 491.0833 572.9305 654.7777 736.6249 818.4722 900.3194 982.1666]
PlntEM4TrqLoss = [0 11.2 22.4 33.6 44.8 56 67.2 78.4 89.6 100.8 112]
PlntEM4Spd = [0 81.8472 163.6944 245.5416 327.3889 409.2361 446.4203 491.0833 572.9305 654.7777 736.6249 818.4722 900.3194 982.1666]
PlntEM4Trq = [112 112 112 112 112 112 112 101.8 87.3 76.4 67.9 61.1 55.5 50.9]

PlntEM4LossTbl = [0 0 0 0 0 0 0 0 0 0 0
 0 258.6 458.3 603.7 804.9 1145.9 1551.3 1809.9 2315.8 2898.7 3928.7
 0 517.1 698.4 895.4 1193.8 1492.3 1790.7 2444.5 2793.7 3622 4024.5
 0 687.5 895.4 1343.1 1500 1875 2250.1 3133.8 3581.5 4714.4 5238.2
 0 916.7 1193.8 1500 2000 2500.1 3000.1 3500.1 4775.3 5372.2 5969.1
 0 1145.9 1492.3 1875 2037.1 2546.4 3055.6 3564.9 5000.1 5625.1 6250.2
 0 1097.5 1363.6 1666.6 1978 2472.5 2608.6 3043.4 3478.2 4450.5 4945
 0 1207.3 1500 1631.9 2175.9 2391.4 2483.9 2897.9 3311.9 3725.9 4139.9
 0 1222.3 1426 1674 2231.9 2414.9 2897.9 3380.9 3863.9 4346.9 4829.9
 0 1193.8 1450.6 1656 2207.9 2759.9 3311.9 3863.9 4415.9 4967.9 5519.8
 0 1343.1 1631.9 1862.9 2483.9 3104.9 3725.9 4346.9 4967.9 5588.8 6209.8
 0 1492.3 1594.2 2069.9 2759.9 3449.9 4139.9 4829.9 5519.8 6209.8 6899.8
 0 1641.5 1753.7 2276.9 3035.9 3794.9 4553.9 5312.9 6071.8 6830.8 7589.8
 0 1790.7 2175.9 2483.9 3311.9 4139.9 4967.9 5795.8 6623.8 7451.8 8279.8]

PlntEM4LossesTbl4d = reshape([0 0 0 0 0 0 0 0 0 0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], 11, 14, 5, 3)
PlntEM4RotDamp = 0

PlntEM4EffTbl = [50 78 80 82 82 80 78 78 76 74 70
 52 78 80 82 82 80 78 78 76 74 70
 52 78 84 86 86 86 86 84 84 82 82
 52 80 86 86 88 88 88 86 86 84 84
 52 80 86 88 88 88 88 88 86 86 86
 52 80 86 88 90 90 90 90 88 88 88
 52 82 88 90 91 91 92 92 92 91 91
 52 82 88 91 91 92 93 93 93 93 93
 52 84 90 92 92 93 93 93 93 93 93
 62 86 91 93 93 93 93 93 93 93 93
 66 86 91 93 93 93 93 93 93 93 93
 70 86 92 93 93 93 93 93 93 93 93
 70 86 92 93 93 93 93 93 93 93 93
 72 86 91 93 93 93 93 93 93 93 93]

PlntEM4EffTbl4d = Simulink.Parameter(reshape([50 78 80 82 82 80 78 78 76 74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], 11, 14, 5, 3))
PlntEM4VPwrLoss = [100 162.5 225 287.5 350]
PlntEM4MaxTqVoltBpt = Simulink.Parameter([100 162.5 225 287.5 350])
PlntEM4MinTqVoltBpt = Simulink.Parameter([100 162.5 225 287.5 350])
PlntEM4EffPwrLossVoltBpt = Simulink.Parameter([100 162.5 225 287.5 350])