% Simulink data dictionary ElectricalCoolingSystem.sldd

BattTempInit = 25
T_set = 20.5
mdot_rev = 0.01
pipe = struct(length=75, Dh=2.5, area=4.908739)
pump = struct(omega=4000, displacement=40)

radiator = struct(
  area_air=0.15,
  volume_air=0.01,
  area_liquid=0.0003141593,
  volume_liquid=0.0001570796,
  mdot_air=[0.1 8],
  mdot_liquid=[0.1 5],
  SD=[1 9; 2 10],
  dp_air=[0.003 0.01],
  dp_liquid=[0.005 0.02])

tank = struct(volume=10, area=0.0625, area_wall=0.375)
valve = struct(area=4.908739, opening=4.810564, area_leak=1.0e-5)
EnvAirTempC = 30